# Grasshopper definition TestScript.gh (Grasshopper 1.0.7)

c_script = CSharpScript(
    run=Toggle(False),
    reset=Button(),
    Reference="C:\Users\nicol\source\repos\SharpMatter\SharpMatter\obj\Debug\SharpMatter.dll")  # -> out, A; inputs run: Boolean, reset: Boolean
# ---------- c_script: C# usings ----------
using SharpMatter.SharpGeometry;
using SharpMatter.SharpPhysics;
using SharpMatter.SharpForces;
# ---------- c_script: C# ----------
    List<Point3d> pos = new List<Point3d>();
    Random ran = new Random();


    double force = 0.5;
    double speed = 0.5;
    double mass = 1;
    double lifeSpan =
      2000;
    double lifeThreshold = 16;
    double lifeDecay = 1;
    Wind windForce = new Wind(new Vec3(0.0002, 0.0006, 0.0002));




    bool dupCondition = false;




    if(run)
    {
      counter++;


      // foreach (SharpParticle item in particles)
      // {


     // for (int i = particles.Count - 1; i >= 0; i--)
    //  {



        //item.Update();
        // item.AddForce(Drag.CalculateDragForce(item, -0.1));

        //item.AddForce(new Vec3(0, 0, -0.01));
        // item.AddForce(windForce.wind);
        // item.Life(item, lifeDecay);



        //pos.Add((Point3d) item.Position);



        //particles[i].Update();

      //  pos.Add((Point3d) particles[i].Position);

       // Print(counter.ToString());
        if(counter == 100)
        {



        dupCondition = true;

          

          //  SharpParticle copy = new SharpParticle(item.Position, item.Acceleration, Vec3.Vector3dRandom(ran), item.MaxSpeed,
          //   item.MaxForce, item.Mass, item.LifeSpan);

          //  SharpParticle copy = new SharpParticle(particles[i].Position, particles[i].Acceleration, Vec3.Vector3dRandom(ran), particles[i].MaxSpeed,
          //     particles[i].MaxForce, particles[i].Mass, particles[i].LifeSpan);
          //  particles.Add(copy);
        dupCondition = false;
          counter = 0;

        }
    //  }


      // }




      // SharpParticle.Die(particles, lifeThreshold);

      if(counter == 100)
      {
        // SharpParticle p = new SharpParticle(Vec3.Zero,
        // Vec3.Zero, Vec3.Vector3dRandom(ran), 0.05, 0.05, 1, lifeSpan);
        // SharpParticle p2 = new SharpParticle(new Vec3(2, 10, 0),
        // Vec3.Zero, Vec3.Vector3dRandom(ran), 0.05, 0.05, 1, lifeSpan);

        //  particles.Add(p);
        // particles.Add(p2);
        //counter = 0;

      }





      Component.ExpireSolution(true);
    }

    if(reset)
    {
      particles.Clear();
      counter = 0;

      for (int i = 0; i < 1; i++)
      {
        SharpParticle p = new SharpParticle(Vec3.VectorRandomDistribution(0, 10, 0, 10, 0, 0, ran), Vec3.Zero
          , Vec3.Vector3dRandom(ran), force, speed, mass, lifeSpan);
        particles.Add(p);
      }


    }


    if(run == false)
    {

      foreach (SharpParticle item in particles)
      {

        pos.Add((Point3d) item.Position);

      }




    }




    A = pos;
# ---------- c_script: C# additional code ----------
  List<SharpParticle> particles = new List<SharpParticle>();
  int counter = 0;


  public void DuplicateParticles(int numberOfDuplicates, Random ran, SharpParticle particle, List<SharpParticle> list)
  {

    for (int i = 0; i < numberOfDuplicates; i++)
    {
      SharpParticle copy = new SharpParticle(particle.Position, particle.Acceleration, Vec3.Vector3dRandom(ran), particle.MaxSpeed,
        particle.MaxForce, particle.Mass, particle.LifeSpan);

      list.Add(copy);


    }


  }
# ---------- end c_script ----------
panel = Panel(c_script.out)
